# Grasshopper definition THR34D5.gh (Grasshopper 0.9.76)
# plug-ins: WebMercatorProjection, SphericalProjection, GetBandsFromFile, CassiniProjection, GetCoordinates, Tarsier, GdalNightmare

# ---- group: ReadTheFile'sData
panel = Panel("C:\Users\Paula\Downloads\gfs.grb2")
read_information_from_grib_files = ReadInformationFromGribFiles(PathToFile=panel, BandToSelect=Slider(5, range=0..10))  # -> CatchErrors, DataSet
get_variable_names_from_file = GetVariableNamesFromFile(PathToFile=panel)  # -> CatchErrors, ListOfVariable
calculate_coordinates_from_file = CalculateCoordinatesFromFile(PathToFile=panel)  # -> CatchErrors, Latitude, Longitude

# ----
panel_2 = Panel("C:\Users\Paula\Downloads\gfs.grb2")
get_variable_names_from_file_2 = GetVariableNamesFromFile(PathToFile="C:\Users\Paula\Desktop\Felipe\Test\sice.20181111.grb2")  # -> CatchErrors, ListOfVariable

# ---- group: RemappingOfOurData
number_slider = Slider(0, range=0..100)
number_slider_2 = Slider(1, range=0..1)
construct_domain = ConstructDomain(DomainStart=number_slider, DomainEnd=number_slider_2)
bounds = Bounds(Numbers=read_information_from_grib_files.DataSet)
bounds_2 = Bounds(Numbers=read_information_from_grib_files.DataSet)
construct_domain_2 = ConstructDomain(DomainStart=Slider(0, range=0..100), DomainEnd=Slider(1000, range=0..100000))
remap_numbers = RemapNumbers(Value=read_information_from_grib_files.DataSet, Source=bounds, Target=construct_domain)  # -> Mapped, Clipped
remap_numbers_2 = RemapNumbers(Value=read_information_from_grib_files.DataSet, Source=bounds_2, Target=construct_domain_2)  # -> Mapped, Clipped

# ---- group: ProjectionTransformations
webmercator = WebMercator(Latitude=calculate_coordinates_from_file.Latitude, Longitude=calculate_coordinates_from_file.Longitude)
spherical = Spherical(Latitude=calculate_coordinates_from_file.Latitude, Longitude=calculate_coordinates_from_file.Longitude)
cassini = Cassini(Latitude=calculate_coordinates_from_file.Latitude, Longitude=calculate_coordinates_from_file.Longitude)

# ---- group: VariableIndexAndNames
panel_3 = Panel(get_variable_names_from_file.ListOfVariable)

# ----
panel_4 = Panel(get_variable_names_from_file_2.ListOfVariable)

# ---- group: ColourGradientFromOurRemappedValues
gradient = Gradient(
    LowerLimit=number_slider,
    UpperLimit=number_slider_2,
    Parameter=remap_numbers.Mapped,
    stops=[0: RGB(243, 57, 0), 0.1: RGB(236, 27, 60), 0.2: RGB(210, 0, 118), 0.3: RGB(103, 0, 120), 0.4: RGB(39, 72, 161), 0.5: RGB(1, 192, 229), 0.6: RGB(18, 178, 90), 0.7: RGB(79, 186, 8), 0.8: RGB(220, 237, 32), 0.9: RGB(247, 159, 20), 1: RGB(243, 57, 0)])

# ---- group: HeightMap
unit_z = UnitZ(Factor=remap_numbers_2.Mapped)
move = Move(Geometry=cassini, Motion=unit_z)  # -> Geometry, Transform
delaunay_mesh = DelaunayMesh(Points=move.Geometry, Plane=PlaneXY(0, 0, 0))
mesh_colours = MeshColours(Mesh=delaunay_mesh, Colours=gradient)

# ---- group: PointCloudViz
construct_point_cloud = ConstructPointCloud(Points=spherical, Colours=gradient)
preview_point_cloud = PreviewPointCloud(PointCloud=construct_point_cloud, Weight=Slider(5, range=0..10))
