# Grasshopper definition Workshop.gh (Grasshopper 0.9.76)
# plug-ins: WebMercatorProjection, SphericalProjection, GetBandsFromFile, CassiniProjection, GetCoordinates, Tarsier, GdalNightmare

panel = Panel("D:\Downloads\gfswind.grb2")
number_slider = Slider(0, range=0..100)
panel_2 = Panel("D:\Downloads\gfsone.grb2")
panel_3 = Panel("D:\Downloads\seaice.grb2")
panel_4 = Panel("D:\Downloads\gfsone.grb2")
# Vorticity
# Temperature
number_slider_2 = Slider(153, range=0..1000)
number_slider_3 = Slider(0, range=0..100)
getcoordinates = CalculateCoordinatesFromFile(
    PathToFile=panel_2,
    SelectRange=Toggle(True),
    MinimumLatitude=Slider(40, range=0..100),
    MaximumLatitude=Slider(45, range=0..100),
    MinimumLongitude=Slider(0, range=0..100),
    MaximumLongitude=Slider(3, range=0..10))  # -> CatchErrors, Latitude, Longitude
readgribfiles = ReadInformationFromGribFiles(PathToFile=panel, BandToSelect=Slider(1, range=0..1))  # -> CatchErrors, DataSet
getcoordinates_2 = CalculateCoordinatesFromFile(
    PathToFile=panel,
    SelectRange=Toggle(False),
    MinimumLatitude=number_slider,
    MaximumLatitude=number_slider,
    MinimumLongitude=number_slider,
    MaximumLongitude=number_slider)  # -> CatchErrors, Latitude, Longitude
readvariablenames = GetVariableNamesFromFile(PathToFile=panel)  # -> CatchErrors, ListOfVariable
readgribfiles_2 = ReadInformationFromGribFiles(PathToFile=panel_2, BandToSelect=Slider(148, range=0..1000))  # -> CatchErrors, DataSet
getcoordinates_3 = CalculateCoordinatesFromFile(
    PathToFile=panel_2,
    SelectRange=Toggle(False),
    MinimumLatitude=number_slider_3,
    MaximumLatitude=number_slider_3,
    MinimumLongitude=number_slider_3,
    MaximumLongitude=number_slider_3)  # -> CatchErrors, Latitude, Longitude
readvariablenames_2 = GetVariableNamesFromFile(PathToFile=panel_2)  # -> CatchErrors, ListOfVariable
number_slider_4 = Slider(0.5, range=0..5)
number_slider_5 = Slider(0, range=0..100)
number_slider_6 = Slider(0.5, range=0..5)
bnd = Bounds(Numbers=readgribfiles.DataSet)
bnd_2 = Bounds(Numbers=readgribfiles_2.DataSet)
sphericalprojection = Spherical(Latitude=getcoordinates_2.Latitude, Longitude=getcoordinates_2.Longitude)
cassiniprojection = Cassini(Latitude=getcoordinates_2.Latitude, Longitude=getcoordinates_2.Longitude)
getcoordinates_4 = CalculateCoordinatesFromFile(
    PathToFile=panel_3,
    SelectRange=Toggle(True),
    MinimumLatitude=Slider(40, range=0..100),
    MaximumLatitude=Slider(45, range=0..100),
    MinimumLongitude=Slider(0, range=0..100),
    MaximumLongitude=Slider(3, range=0..10))  # -> CatchErrors, Latitude, Longitude
getcoordinates_5 = CalculateCoordinatesFromFile(
    PathToFile=panel_3,
    SelectRange=Toggle(False),
    MinimumLatitude=Slider(40, range=0..100),
    MaximumLatitude=Slider(45, range=0..100),
    MinimumLongitude=Slider(0, range=0..100),
    MaximumLongitude=Slider(3, range=0..10))  # -> CatchErrors, Latitude, Longitude
bnd_3 = Bounds(Numbers=readgribfiles_2.DataSet)
sphericalprojection_2 = Spherical(Latitude=getcoordinates_3.Latitude, Longitude=getcoordinates_3.Longitude)
cassiniprojection_2 = Cassini(Latitude=getcoordinates_3.Latitude, Longitude=getcoordinates_3.Longitude)
sphericalprojection_3 = Spherical(Latitude=getcoordinates.Longitude, Longitude=getcoordinates.Latitude)
panel_5 = Panel(readvariablenames.ListOfVariable)
dom = ConstructDomain(DomainStart=Slider(0, range=0..100), DomainEnd=Slider(5000, range=0..10000))
dom_2 = ConstructDomain(DomainStart=number_slider_5, DomainEnd=number_slider_6)
panel_6 = Panel(readvariablenames_2.ListOfVariable)
remap = RemapNumbers(Value=readgribfiles.DataSet, Source=bnd, Target=Domain(0, 1))  # -> Mapped, Clipped
remap_2 = RemapNumbers(Value=readgribfiles_2.DataSet, Source=bnd_2, Target=dom)  # -> Mapped, Clipped
sphericalprojection_4 = Spherical(Latitude=getcoordinates_5.Latitude, Longitude=getcoordinates_5.Longitude)
sphericalprojection_5 = Spherical(Latitude=getcoordinates_4.Longitude, Longitude=getcoordinates_4.Latitude)
webmercatorprojection = WebMercator(Latitude=getcoordinates_3.Latitude, Longitude=getcoordinates_3.Longitude)
del = DelaunayMesh(Points=cassiniprojection, Plane=PlaneXY(0, 0, 0))
remap_3 = RemapNumbers(Value=readgribfiles_2.DataSet, Source=bnd_3, Target=dom_2)  # -> Mapped, Clipped
gradient = Gradient(
    LowerLimit=number_slider_6,
    UpperLimit=number_slider_5,
    Parameter=remap_3.Mapped,
    stops=[0: RGB(243, 57, 0), 0.1: RGB(236, 27, 60), 0.2: RGB(210, 0, 118), 0.3: RGB(103, 0, 120), 0.4: RGB(39, 72, 161), 0.5: RGB(1, 192, 229), 0.6: RGB(18, 178, 90), 0.7: RGB(79, 186, 8), 0.8: RGB(220, 237, 32), 0.9: RGB(247, 159, 20), 1: RGB(243, 57, 0)])
Z = UnitZ(Factor=remap_2.Mapped)
move = Move(Geometry=webmercatorprojection, Motion=Z)  # -> Geometry, Transform
frgb = ColourRGBF(Alpha=1, Red=remap.Mapped, Green=0, Blue=0)
construct = ConstructPointCloud(Points=sphericalprojection, Colours=frgb)
construct_2 = ConstructPointCloud(Points=move.Geometry, Colours=gradient)
mcol = MeshColours(Mesh=del, Colours=frgb)
readgribfiles_3 = ReadInformationFromGribFiles(PathToFile=panel_3, BandToSelect=Slider(1, range=0..1))  # -> CatchErrors, DataSet
frgb_2 = ColourRGBF(Alpha=1, Red=readgribfiles_3.DataSet, Green=0, Blue=0)
frgb_3 = ColourRGBF(Alpha=1, Red=remap_3.Mapped, Green=0, Blue=0)
preview = PreviewPointCloud(PointCloud=construct, Weight=Slider(2, range=0..10))
del_2 = DelaunayMesh(Points=move.Geometry, Plane=PlaneXY(0, 0, 0))
construct_3 = ConstructPointCloud(Points=sphericalprojection_4, Colours=frgb_2)
preview_2 = PreviewPointCloud(PointCloud=construct_2, Weight=Slider(7, range=0..10))
mcol_2 = MeshColours(Mesh=del_2, Colours=gradient)
preview_3 = PreviewPointCloud(PointCloud=construct_3, Weight=Slider(3, range=0..10))
